vi "ASKRx Template.gvi"   [LabVIEW Communications System Design Software 2.0.1]
panel controls:
  "IQ rate": f64 = 1000000
  "carrier frequency": f64 = 915000000
  "gain (dB)": f64
  "active antenna": string = "RX2"
  "message length (bits)": i64 = 1000
  "symbol rate (sym/s)": i64 = 10000
  "pulse shaping filter": T1 = "none"
  "niUSRP Device": "niUSRPClass"
panel indicators:
  "actual IQ rate": f64
  "actual carrier frequency": f64
  "actual gain (dB)": f64
  "error out": error
  "Output bits": f64[]
  "Baseband Output": cluster{"t0": f64, "dt": f64, "Y": f64[]}
  "Eye Diagram": cluster{"t0": f64, "dt": f64, "Y": f64[]}[]
types:
  T1 = enum{"none", "Raised Cosine", "Root Raised Cos", "Gaussian"}
uses:
  NI::Analysis::Operations::1D Convolution (DBL).gvi
diagram:
  call "niUSRP Open Rx Session.gvi"(niUSRP Device=$"niUSRP Device") -> (error out=w1, session handle out=w2)
  call "niUSRP Configure Signal.gvi"(session handle=w2, IQ rate=$"IQ rate", carrier frequency=$"carrier frequency", gain=$"gain (dB)", error in (no error)=w1, active antenna=$"active antenna") -> (session handle out=w3, coerced IQ rate=w4, coerced carrier frequency=w5, coerced gain=w6, Error Out=w7)
  # bir de double'ı ikinci göze sokarak dene
  call "niUSRP Initiate.gvi"(session handle=w3, error in (no error)=w7) -> (session handle out=w8, Error Out=w9)
  # no. samples
  # samples/symbol
  Divide(x=w4, y=$"symbol rate (sym/s)") -> w10
  Multiply(2, w10) -> w11
  Multiply($"message length (bits)", w11) -> w12
  call "niUSRP Fetch Rx Data (CDB Cluster).gvi"(session handle=w8, number of samples=w12, error in (no error)=w9) -> (session handle out=w13, data=w14, Error Out=w15)
  Property Node(instance in=w14) -> ("dt"=w16, "Y"=w17, "dt"=w18)
  call "MT Generate Filter Coefficients.gvi"(pulse shaping filter=$"pulse shaping filter", pulse shaping samples per symbol=w10, error in=w15, modulation type="ASK") -> (matched filter coefficients=w19, error out=w20)
  Reciprocal(x=w18) -> w21
  Complex To Real Imaginary(x + iy=w17) -> (x=w22)
  call "Chebyshev Filter (DBL).gvi"(filter type="Bandpass", X=w22, sampling freq: fs=w21, high cutoff freq: fh=110000, low cutoff freq: fl=90000, order=5) -> (Filtered X=w23)
  Complex To Polar(r * e^(i*theta)=w23) -> (r=w24)
  call "1D Convolution (DBL).gvi"(x=w24, y=w19, error in=w20) -> (x * y=w25, error out=w26)
  w27 = cluster{"t0": f64, "dt": f64, "Y": f64[]} {all zero or empty}
  Property Node(instance in=w27, "dt"=w16, "Y"=w25) -> (instance out=w28)  # Cluster Properties
  $"Baseband Output" <- w28
  Property Node(instance in=w28) -> ("Y"=w29)
  $"Output bits" <- w29
  call "PulseAlign(real).gvi"(Input Signal=w28, Receiver Sampling Factor=w10) -> (Aligned Signal=w30)
  call "MT Format Eye Diagram (complex).gvi"(waveform=w30, symbol rate=$"symbol rate (sym/s)", eye length=2, error in=w26) -> (eye diagram=w31, error out=w32)
  call "niUSRP Abort.gvi"(Handle in=w13, error in (no error)=w32) -> (Handle out=w33, Error Out=w34)
  call "niUSRP Close Session.gvi"(handle in=w33, error in=w34) -> (error out=w35)
  call "Simple Error Handler.gvi"(error in=w35) -> (error out=w36)
  $"error out" <- w36
  $"actual IQ rate" <- w4
  $"Eye Diagram" <- w31
  $"actual carrier frequency" <- w5
  $"actual gain (dB)" <- w6
