vi "ASKTxTemplate (1).gvi"   [LabVIEW Communications System Design Software 2.0.1]
panel controls:
  "IQ rate": f64 = 200000
  "carrier frequency": f64 = 915100000
  "gain (dB)": f64
  "active antenna": string = "TX1"
  "symbol rate (sym/s)": i32 = 10000
  "Stop": bool
  "Device names": "niUSRPClass"
  "pulse shaping filter": T2 = "none"
  "adc.m path": "adc.m path_2.gtype" = path "C:\\Users\\MSI\\Documents\\MATLAB\\5\\EE3001\\MATLAB Exercises\\Project\\newsound"
  "Noise Selection": "Noise Selection.gtype" = "Fan Noise"
panel indicators:
  "actual IQ rate": f64
  "actual carrier frequency": f64
  "actual gain (dB)": f64
  "error out": error
  "Baseband Waveform": waveform<f64>
  "Power Spectrum": T1
  "Message Waveform (Binary)": f64[]
  "Noise Input Signal": f64[]
types:
  T1 = cluster{"f0": f64, "df": f64, "magnitude": f64[]}
  T2 = enum{"none", "Raised Cosine", "Root Raised Cos", "Gaussian"}
  "adc.m path_2.gtype" = path
  "Noise Selection.gtype" = enum{"Fan Noise", "Merhaba"}
  T3 = cluster{"whole seconds": u64, "fractional seconds": f64}
uses:
  NI::Analysis::Resampling::Upsample (DBL).gvi
  NI::Analysis::Operations::1D Convolution (DBL).gvi
diagram:
  Number To Decimal String(number=$"Noise Selection") -> (decimal integer string=w1)
  Concatenate Strings("matlab -batch \"adc ", w1, "; exit\"") -> w2
  call "System Exec.gvi"(command line=w2, working directory=$"adc.m path")
  Path To String(path=$"adc.m path") -> (string=w3)
  Concatenate Strings(w3, "\\reference.txt") -> w4
  String To Path(string=w4) -> (path=w5)
  call "Read from Spreadsheet File (DBL).gvi"(file path=w5) -> (all rows=w6)
  Array Index(array=w6) -> (out0[_, 0]=w7)
  case ($"Noise Selection") {
    frame "Fan Noise" {
      w8 = "\\fanNoise.txt"
    }
    frame "Merhaba" {
      w8 = "\\drillSound.txt"
    }
  }
  Concatenate Strings(w3, w8) -> w9
  String To Path(string=w9) -> (path=w10)
  call "Read from Spreadsheet File (DBL).gvi"(file path=w10) -> (all rows=w11)
  Array Index(array=w11) -> (out0[_, 0]=w12)
  Add(w7, w12) -> w13
  $"Noise Input Signal" <- w13
  Path To String(path=$"adc.m path") -> (string=w14)
  Concatenate Strings(w14, "\\adc.txt") -> w15
  String To Path(string=w15) -> (path=w16)
  while {
    Wait(time to wait=500)
    Open Or Create Or Replace File(file path (use dialog)=w16) -> (error out=w17)
    call "Is Error.gvi"(error in=w17) -> (is error?=w18)
    Not(x=w18) -> w19
    stop if w19
  }
  while {
    call "Read from Spreadsheet File (DBL).gvi"(file path=w16) -> (all rows=w20)
    Array Index(array=w20) -> (out0[_, 0]=w21)
    Is Empty Array(array=w21) -> w22
    Wait(time to wait=500)
    continue if w22
  }
  $"Message Waveform (Binary)" <- w21
  call "niUSRP Open Tx Session.gvi"(Device names=$"Device names") -> (session handle out=w23, Error Out=w24)
  call "niUSRP Configure Signal.gvi"(session handle=w23, IQ rate=$"IQ rate", carrier frequency=$"carrier frequency", gain=$"gain (dB)", error in (no error)=w24, active antenna=$"active antenna") -> (session handle out=w25, coerced IQ rate=w26, coerced carrier frequency=w27, coerced gain=w28, Error Out=w29)
  call "niUSRP Configure Time Start Trigger.gvi"(session handle=w25, start trigger time=T3 {"whole seconds"=20, "fractional seconds"=0}, error in (no error)=w29) -> (session handle out=w30)
  Divide(x=w26, y=$"symbol rate (sym/s)") -> w31
  # Upsampling
  call "Upsample (DBL).gvi"(input array=w21, upsampling factor=w31) -> (upsampled array=w32)
  # Symbol Mapping
  call "MT Generate Filter Coefficients.gvi"(pulse shaping filter=$"pulse shaping filter", pulse shaping samples per symbol=w31, modulation type="ASK") -> (pulse shaping filter coefficients=w33)
  call "1D Convolution (DBL).gvi"(x=w32, y=w33) -> (x * y=w34)
  # Pulse Shaping
  Absolute Value(x=w34) -> w35
  call "Quick Scale 1D.gvi"(X=w35) -> (max|X|=w36)
  Divide(x=w34, y=w36) -> w37
  Decrement(x=w37) -> w38
  Divide(x=w38, y=2) -> w39
  # Modulation
  Reciprocal(x=w26) -> w40
  w41 = cluster{"t0": timestamp, "dt": f64, "Y": c128[]} {all zero or empty}
  Property Node(instance in=w41, "Y"=w39, "dt"=w40) -> (instance out=w42)
  call "FFT Power Spectrum for 1 Chan (CDB)2.gvi"(time signal=w42) -> (power spectrum=w43, Error Out=w44)
  call "niUSRP Write Tx Data (CDB).gvi"(session handle=w30, data=w39, timeout=30, end of data?=$Stop, error in (no error)=w44) -> (session handle out=w45, Error Out=w46)
  call "niUSRP Close Session.gvi"(handle in=w45, error in=w46) -> (error out=w47)
  call "Simple Error Handler.gvi"(error in=w47) -> (error out=w48)
  $"error out" <- w48
  $"actual IQ rate" <- w26
  $"actual carrier frequency" <- w27
  $"actual gain (dB)" <- w28
  $"Power Spectrum" <- w43
  Build Waveform Node(Y=w39, dt=w40) -> (output waveform=w49)
  $"Baseband Waveform" <- w49
