vi "askrx_new.gvi"   [LabVIEW Communications System Design Software 2.0.1]
panel controls:
  "wavconverter.m": "wavconverter.m_2.gtype" = path "C:\\Users\\MSI\\Documents\\MATLAB\\5\\EE3001\\MATLAB Exercises\\Project\\newsound"
  "IQ rate": f64 = 1000000
  "carrier frequency": f64 = 915000000
  "gain (dB)": f64
  "active antenna": string = "RX2"
  "symbol rate (sym/s)": i64 = 10000
  "pulse shaping filter": T1 = "none"
  "niUSRP Device": "niUSRPClass"
  "Channel 2": f64
  "Channel 3": f64
  "Channel 1": f64
  "Volume": f64
panel indicators:
  "actual IQ rate": f64
  "actual carrier frequency": f64
  "actual gain (dB)": f64
  "error out": error
  "Baseband Output": cluster{"t0": f64, "dt": f64, "Y": f64[]}
  "Output Waveform": waveform<f64>
types:
  "wavconverter.m_2.gtype" = path
  T1 = enum{"none", "Raised Cosine", "Root Raised Cos", "Gaussian"}
  T2 = cluster{"whole seconds": u64, "fractional seconds": f64}
  "Sound Data Format.gtype" = cluster{"sample rate (S/s)": f64, "number of channels": i32, "bits per sample": i32}
uses:
  NI::Analysis::Operations::1D Convolution (DBL).gvi
  NI::Analysis::Resampling::Resample (constant to constant, single-channel).gvi
  NI::Analysis::Filtering::Butterworth Lowpass Filter NChan (DBL).gvi
  NI::Analysis::Filtering::Butterworth Highpass Filter NChan (DBL).gvi
  NI::Analysis::Measurement::Power Spectrum for 1 Chan.gvi
diagram:
  call "niUSRP Open Rx Session.gvi"(niUSRP Device=$"niUSRP Device") -> (error out=w1, session handle out=w2)
  call "niUSRP Configure Signal.gvi"(session handle=w2, IQ rate=$"IQ rate", carrier frequency=$"carrier frequency", gain=$"gain (dB)", error in (no error)=w1, active antenna=$"active antenna") -> (session handle out=w3, coerced IQ rate=w4, coerced carrier frequency=w5, coerced gain=w6, Error Out=w7)
  call "niUSRP Configure Time Start Trigger.gvi"(session handle=w3, start trigger time=T2 {"whole seconds"=20, "fractional seconds"=0}, error in (no error)=w7) -> (session handle out=w8, Error Out=w9)
  while {
    call "niUSRP Initiate.gvi"(session handle=w8, error in (no error)=w9) -> (session handle out=w10, Error Out=w11)
    call "Is Error.gvi"(error in=w11) -> (is error?=w12)
    Not(x=w12) -> w13
    Wait(time to wait=500)
    stop if w13
  }
  # no. samples
  # samples/symbol
  Divide(x=w4, y=$"symbol rate (sym/s)") -> w14
  Multiply(224000, w14) -> w15
  # bir de double'ı ikinci göze sokarak dene
  call "niUSRP Fetch Rx Data (CDB Cluster).gvi"(session handle=w10, number of samples=w15, timeout=50, error in (no error)=w11) -> (session handle out=w16, data=w17, Error Out=w18)
  Property Node(instance in=w17) -> ("dt"=w19, "Y"=w20, "dt"=w21)
  call "MT Generate Filter Coefficients.gvi"(pulse shaping filter=$"pulse shaping filter", pulse shaping samples per symbol=w14, error in=w18, modulation type="ASK") -> (matched filter coefficients=w22, error out=w23)
  Reciprocal(x=w21) -> w24
  Complex To Real Imaginary(x + iy=w20) -> (x=w25)
  call "Chebyshev Filter (DBL).gvi"(filter type="Bandpass", X=w25, sampling freq: fs=w24, high cutoff freq: fh=20000, low cutoff freq: fl=20, order=5) -> (Filtered X=w26)
  To Double Precision Complex(number=w26) -> w27
  Complex To Polar(r * e^(i*theta)=w27) -> (r=w28)
  call "1D Convolution (DBL).gvi"(x=w28, y=w22, error in=w23) -> (x * y=w29, error out=w30)
  w31 = cluster{"t0": f64, "dt": f64, "Y": f64[]} {all zero or empty}
  Property Node(instance in=w31, "dt"=w19, "Y"=w29) -> (instance out=w32)  # Cluster Properties
  $"Baseband Output" <- w32
  To Double Precision Float(number=$"symbol rate (sym/s)") -> w33
  To Long Integer(number=w14) -> w34
  call "PulseAlign(real).gvi"(Input Signal=w32, Receiver Sampling Factor=w34) -> (Aligned Signal=w35)
  call "MT Format Eye Diagram (complex).gvi"(waveform=w35, symbol rate=w33, eye length=2, error in=w30) -> (error out=w36)
  call "niUSRP Abort.gvi"(Handle in=w16, error in (no error)=w36) -> (Handle out=w37, Error Out=w38)
  call "niUSRP Close Session.gvi"(handle in=w37, error in=w38) -> (error out=w39)
  call "Simple Error Handler.gvi"(error in=w39) -> (error out=w40)
  $"error out" <- w40
  $"actual IQ rate" <- w4
  $"actual carrier frequency" <- w5
  $"actual gain (dB)" <- w6
  Property Node(instance in=w32) -> ("Y"=w41)
  call "Resample (constant to constant, single-channel).gvi"(signal=w41, resampled dt=100) -> (resampled signal=w42)
  Path To String(path=$"wavconverter.m") -> (string=w43)
  Concatenate Strings(w43, "\\istiklal_output.txt") -> w44
  String To Path(string=w44) -> (path=w45)
  # Reading the original bitstream without error
  while {
    Wait(time to wait=500)
    Open Or Create Or Replace File(file path (use dialog)=w45) -> (error out=w46)
    call "Is Error.gvi"(error in=w46) -> (is error?=w47)
    Not(x=w47) -> w48
    stop if w48
  }
  call "Read from Spreadsheet File (DBL).gvi"(file path=w45) -> (all rows=w49)
  Array Index(array=w49) -> (out0[_, 0]=w50)
  Array Size(array=w50) -> (size(s)=w51)
  Reshape Array(inArray=w42, size=w51) -> w52
  Build Array(w52, w50) -> w53
  call "Butterworth Lowpass Filter NChan (DBL).gvi"(signal=w53, cutoff frequency=20000) -> (filtered signal=w54, error out=w55)
  call "Butterworth Highpass Filter NChan (DBL).gvi"(signal=w54, cutoff frequency=8000, error in=w55) -> (filtered signal=w56)
  Multiply(w56, $"Channel 3") -> w57
  call "Butterworth Lowpass Filter NChan (DBL).gvi"(signal=w53, cutoff frequency=2000) -> (filtered signal=w58, error out=w59)
  call "Butterworth Highpass Filter NChan (DBL).gvi"(signal=w58, cutoff frequency=20, error in=w59) -> (filtered signal=w60)
  Multiply(w60, $"Channel 1") -> w61
  call "Butterworth Lowpass Filter NChan (DBL).gvi"(signal=w53, cutoff frequency=8000) -> (filtered signal=w62, error out=w63)
  call "Butterworth Highpass Filter NChan (DBL).gvi"(signal=w62, cutoff frequency=2000, error in=w63) -> (filtered signal=w64)
  Multiply(w64, $"Channel 2") -> w65
  Add(w61, w65) -> w66
  Add(w66, w57) -> w67
  Multiply(w67, $Volume) -> w68
  w69 = "Sound Data Format.gtype" {"sample rate (S/s)"=8000, "number of channels"=2, "bits per sample"=16}
  # Playing the sounds
  for {
    w70 = each element of w68
    Build Waveform Node(Y=w70) -> (output waveform=w71)
    Build Array(w71) -> w72
    call "Sound Output Configure.gvi"(device ID=0, sound format=w69) -> (task ID=w73, error out=w74)
    call "Sound Output Start.gvi"(task ID in=w73, error in=w74) -> (task ID out=w75, error out=w76)
    call "Sound Output Write.gvi"(task ID in=w75, data=w72, error in=w76) -> (task ID out=w77, error out=w78)
    call "Sound Output Start.gvi"(task ID in=w77, error in=w78) -> (task ID out=w79, error out=w80)
    call "Sound Output Wait.gvi"(task ID in=w79, error in=w80) -> (task ID out=w81, error out=w82)
    call "Sound Output Stop.gvi"(task ID in=w81, error in=w82) -> (task ID out=w83, error out=w84)
    call "Sound Output Clear.gvi"(task ID=w83, error in=w84)
    call "Power Spectrum for 1 Chan.gvi"(signal=w71) -> (power spectrum=w85)
    Property Node(instance in=w85) -> ("df"=w86, "magnitude"=w87)
    Build Waveform Node(Y=w87, dt=w86) -> (output waveform=w88)
    $"Output Waveform" <- w88
  }
